# Grasshopper definition llm_requests.gh (Grasshopper 1.0.8)
# plug-ins: RhinoCodePluginGH

py3 = Python3Script(input_text="how do i bake cookies?", run=Toggle(True))  # -> out, out_2
# ---------- py3: Python ----------
import requests

url = 'http://localhost:5000/llm_call'
payload = {'input': input_text}


out = None
if run:
    response = requests.post(url, json=payload)

    if response.status_code == 200:
        data = response.json()
        out = data['response']
    else:
        out = "Failed to connect:"

a = out
# ---------- end py3 ----------
panel = Panel(py3.out_2)
